# Grasshopper definition Test.gh (Grasshopper 1.0.7)

pt = Point(Point(1.684991409, -0.2647098481, 0))
crv = Curve(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)
repeat = RepeatData(Data=pt, Length=Slider(1000, range=0..1000))
c_script = CSharpScript(
    crv=crv,
    pt=repeat,
    Reference=["C:\Users\yanga\Documents\github\MinusDesignLabs-backend\src\MinusDesignLabs-Backend\MinusDesignLabsModel\bin\Debug\net6.0\MinusDesignLabsModel.dll", "C:\Users\yanga\Documents\github\MinusDesignLabs-backend\src\MinusDesignLabs-Backend\MinusDesignLabsLocal\bin\Debug\MinusDesignLabsLocal.dll"])  # -> out, A; inputs crv: Curve, pt: list of Point3d
# ---------- c_script: C# usings ----------
using MinusDesignLabsLocal;
# ---------- c_script: C# ----------
    DesignProjectAPIs.Instance.TestEndPoint(crv, pt);
# ---------- end c_script ----------
